# Grasshopper definition Identificação de peças.gh (Grasshopper 1.0.7)
# plug-ins: PTComponentLibrary

espessura = Slider(0.25, range=0..1)
altura = Slider(0.6, range=0..1)
altura_disco_central = Slider(0.5, range=0..1)
number_slider = Slider(2.35, range=0..3)
surface = Surface(<surface referenced from the Rhino model>)
# Pontos de Observação:
# 1. Localização do disco central: a depender de onde está localizado e da distancia entre nervuras, o disco pode criar conexões complexas
panel = Panel("Definição da Forma")

# ----
# Identificação da curva que define o disco central
number_slider_2 = Slider(4, range=0..4)
brep_edges = BrepEdges(Brep=surface)  # -> Naked, Interior, NonManifold
list_item = ListItem(List=brep_edges.Naked, Index=number_slider_2, Wrap=True)

# ---- group: cálculo da área da superfície
# Cálculo da área da superfície que dá origem a estrutura complexa
area = Area(Geometry=surface)  # -> Area, Centroid

# ----
unit_z = UnitZ(Factor=altura)
unit_x = UnitX(Factor=espessura)

# ----
# Divide a superficie em partes iguais no sentido y
unit_y = UnitY(Factor=altura)
contour = Contour(Shape=surface, Point=area.Centroid, Direction=unit_y, Distance=number_slider)

# ----
# Cálculo de H' (Espessura útil da peça após criação do encaixe)
curvas_x = Curve(flatten(contour))
move = Move(Geometry=curvas_x, Motion=unit_z)  # -> Geometry, Transform

# ----
# Avaliação do Grau de curvatura
# Criação das subsuperfícies dentro da superfície
number_slider_3 = Slider(30, range=0..100)
# Cálculo do angulo entre o vetor normal ao plano tangente no ponto
number_slider_4 = Slider(30, range=0..100)
divide_domain² = DivideDomain²(Domain=surface, UCount=number_slider_3, VCount=number_slider_4)
isotrim = Isotrim(Surface=surface, Domain=divide_domain²)

# ---- group: X axis
# Divide a superficie em partes iguais no sentido x
unit_x_2 = UnitX(Factor=1)
contour_2 = Contour(Shape=surface, Point=area.Centroid, Direction=unit_x_2, Distance=number_slider)

# ----
curvas_y = Curve(flatten(contour_2))

# ---- group: Identifica intersecção das curvas
intersect_curves = IntersectCurves(CU=curvas_y, CV=curvas_x)
clean_tree = CleanTree(RemoveNulls=True, RemoveInvalid=True, RemoveEmpty=False, Tree=intersect_curves)

# ----
srf_cp = SurfaceClosestPoint(Point=clean_tree, Surface=surface)  # -> Point, UVPoint, Distance
curvature = SurfaceCurvature(Surface=surface, Point=srf_cp.UVPoint)  # -> Frame, Gaussian, Mean

# ---- group: H' no sentido Y
ghpython_script = GhPythonScript(alturaDaNervura=altura)  # -> a
# ---------- ghpython_script: Python ----------
a = alturaDaNervura/2
# ---------- end ghpython_script ----------
unit_y_2 = UnitY(Espessura=espessura)
unit_z_2 = UnitZ(Factor=ghpython_script)
move_2 = Move(Geometry=intersect_curves, Motion=unit_z_2)  # -> Geometry, Transform
panel_2 = Panel(move_2.Geometry)
move_3 = Move(Geometry=move_2.Geometry, Motion=unit_y_2)  # -> Geometry, Transform
panel_3 = Panel(move_3.Geometry)
partition_list = PartitionList(List=move_2.Geometry, Size="1")
partition_list_2 = PartitionList(List=move_3.Geometry, Size="1")
merge = Merge(Data1=partition_list, Data2=partition_list_2)
panel_4 = Panel(merge)
partition_list_3 = PartitionList(List=curvas_y, Size="1")
panel_5 = Panel(partition_list_3)
simplify_tree = SimplifyTree(Tree=merge, Front=False)
trim_tree = TrimTree(Tree=simplify_tree, Depth=1)
clean_tree_2 = CleanTree(RemoveNulls=True, RemoveInvalid=True, RemoveEmpty=False, Tree=trim_tree)
panel_6 = Panel(clean_tree_2)
curve_closest_point = CurveClosestPoint(Point=clean_tree_2, Curve=partition_list_3)  # -> Point, Parameter, Distance
panel_7 = Panel(curve_closest_point.Point)
line = Line(StartPoint=clean_tree_2, EndPoint=curve_closest_point.Point)
panel_8 = Panel(line)
length = Length(Curve=line)
panel_9 = Panel(length)
partition_list_4 = PartitionList(List=length, Size=Slider(2, range=0..10))
panel_10 = Panel(partition_list_4)
sort_list = SortList(Keys=partition_list_4)  # -> Keys, ValuesValuesA
panel_11 = Panel(sort_list.Keys)
list_item_2 = ListItem(List=sort_list.Keys, Index=Slider(0, range=0..1), Wrap=True)

# ----
panel_12 = Panel(clean_tree)
move_4 = Move(Geometry=move_2.Geometry, Motion=unit_x)  # -> Geometry, Transform
point = Point(move_2.Geometry)
# Cálculo da Curvatura Gaussiana e Média no ponto
curvatura_gaussiana = Panel(curvature.Gaussian)

# ---- group: H' no sentido X
partition_list_5 = PartitionList(List=move_4.Geometry, Size="1")
partition_list_6 = PartitionList(List=point, Size="1")
simplify_tree_2 = SimplifyTree(Tree=partition_list_5, Front=False)
partition_list_7 = PartitionList(List=move.Geometry, Size="1")
simplify_tree_3 = SimplifyTree(Tree=partition_list_6, Front=False)
trim_tree_2 = TrimTree(Tree=simplify_tree_2, Depth=1)
trim_tree_3 = TrimTree(Tree=simplify_tree_3, Depth=1)
panel_13 = Panel(partition_list_7)
flip_matrix = FlipMatrix(Data=trim_tree_2)
flip_matrix_2 = FlipMatrix(Data=trim_tree_3)
panel_14 = Panel(trim_tree_3)
clean_tree_3 = CleanTree(RemoveNulls=True, RemoveInvalid=True, RemoveEmpty=False, Tree=flip_matrix)
clean_tree_4 = CleanTree(RemoveNulls=True, RemoveInvalid=True, RemoveEmpty=False, Tree=flip_matrix_2)
panel_15 = Panel(clean_tree_4)
curve_closest_point_2 = CurveClosestPoint(Point=clean_tree_3, Curve=partition_list_7)  # -> Point, Parameter, Distance
curve_closest_point_3 = CurveClosestPoint(Point=clean_tree_4, Curve=partition_list_7)  # -> Point, Parameter, Distance
panel_16 = Panel(curve_closest_point_3.Point)
line_2 = Line(StartPoint=clean_tree_4, EndPoint=curve_closest_point_3.Point)
line_3 = Line(StartPoint=clean_tree_3, EndPoint=curve_closest_point_2.Point)
panel_17 = Panel(line_2)
length_2 = Length(Curve=line_2)
panel_18 = Panel(length_2)
length_3 = Length(Curve=line_3)
partition_list_8 = PartitionList(List=[length_2, length_3], Size=Slider(2, range=0..10))
panel_19 = Panel(partition_list_8)
sort_list_2 = SortList(Keys=partition_list_8)  # -> Keys, ValuesValuesA
sort_list_3 = SortList(Keys=partition_list_8)  # -> flatten(Keys), ValuesValuesA
panel_20 = Panel(sort_list_2.Keys)
list_item_3 = ListItem(List=sort_list_2.Keys, Index=Slider(0, range=0..1), Wrap=True)
bounds = Bounds(Numbers=sort_list_3.Keys)
panel_21 = Panel(bounds)
panel_22 = Panel(list_item_3)

# ----
pontos_uv = Panel(srf_cp.UVPoint)
intersect_curves_2 = IntersectCurves(CU=contour, CV=contour_2)
curvatura_média = Panel(curvature.Mean)

# ----
# Definição do grau de curvatura a partir do ponto central da subsuperfície
area_2 = Area(Geometry=isotrim)  # -> Area, Centroid
surface_closest_point = SurfaceClosestPoint(Point=area_2.Centroid, Surface=isotrim)  # -> Point, UVPoint, Distance
principal_curvature = PrincipalCurvature(Surface=isotrim, Point=surface_closest_point.UVPoint)  # -> Frame, Maximum, Minimum, MaxDirection, MinDirection

panel_23 = Panel(contour_2)
espessura_2 = Slider(0.25, range=0..1)
espessura_3 = Slider(0.2, range=0..1)

# ----
# Calculo do angulo entre vetores (global e normal do plano tangente)
# - remove valores nulos
# - Projeta os pontos na superfície para que possa ser trabalhado com valores UV
# - Avalia a superfície para identificação da normal dos planos no pontos de intersecção
flip_matrix_3 = FlipMatrix(Data=clean_tree)
surface_closest_point_2 = SurfaceClosestPoint(Point=flip_matrix_3, Surface=surface)  # -> Point, UVPoint, Distance
list_item_4 = ListItem(List=surface_closest_point_2.Point, Index=Slider(0, range=0..20), Wrap=True)
panel_25 = Panel(surface_closest_point_2.Point)
evaluate_surface = EvaluateSurface(Surface=surface, Point=surface_closest_point_2.UVPoint)  # -> Point, Normal, UDirection, VDirection, Frame
point_2 = Point(evaluate_surface.Point)
normal = Normal(evaluate_surface.Normal)
vector_display = VectorDisplay(Anchor=evaluate_surface.Point, Vector=expr("x * -1", evaluate_surface.Normal))
unit_z_3 = UnitZ(Factor=1)
unit_x_3 = UnitX(Factor=1)
unit_y_3 = UnitY(Factor=1)
angle = Angle(VectorA=unit_z_3, VectorB=expr("-x", evaluate_surface.Normal))  # -> Angle, Reflex
angle_2 = Angle(VectorA=unit_x_3, VectorB=expr("-x", evaluate_surface.Normal))  # -> Angle, Reflex
angle_3 = Angle(VectorA=unit_y_3, VectorB=expr("-x", evaluate_surface.Normal))  # -> Angle, Reflex
degrees = Degrees(Radians=angle.Angle)
degrees_2 = Degrees(Radians=angle_2.Angle)
panel_26 = Panel(angle.Angle)
degrees_3 = Degrees(Radians=angle_3.Angle)
panel_27 = Panel(angle_2.Angle)
panel_28 = Panel(angle_3.Angle)

# ---- group: Aplica altura as linhas x
unit_z_4 = UnitZ(Factor=altura)
extrude = Extrude(Base=contour_2, Direction=unit_z_4)

# ---- group: Aplica altura as linhas Y
unit_z_5 = UnitZ(Factor=altura)
extrude_2 = Extrude(Base=contour, Direction=unit_z_5)

# ----
# Definição dos limites máximos e mínimos  para atribuição das cores:
# bounds - define valor máximo e mínimo do intervalo de valores
# Deconstruct domain - separa os valores maio e menor do bounds
bounds_2 = Bounds(Numbers=principal_curvature.Maximum)
deconstruct_domain = DeconstructDomain(Domain=bounds_2)  # -> Start, End

# ----
# - remove valores nulos
# - Projeta os pontos na superfície para que possa ser trabalhado com valores UV
# - Avalia a superfície para identificação da normal dos planos no pontos de intersecção
surface_closest_point_3 = SurfaceClosestPoint(Point=clean_tree, Surface=surface)  # -> Point, UVPoint, Distance
evaluate_surface_2 = EvaluateSurface(Surface=surface, Point=surface_closest_point_3.UVPoint)  # -> Point, Normal, UDirection, VDirection, Frame

# ----
# Calculo do angulo entre vetores (global e normal do plano tangente)
number_slider_5 = Slider(20, range=0..20)
panel_29 = Panel(surface_closest_point_3.Point)
list_item_5 = ListItem(List=surface_closest_point_3.Point, Index=number_slider_5, Wrap=True)
vector_display_2 = VectorDisplay(Anchor=evaluate_surface_2.Point, Vector=expr("x * -1", evaluate_surface_2.Normal))
unit_z_6 = UnitZ(Factor=1)
unit_x_4 = UnitX(Factor=1)
unit_y_4 = UnitY(Factor=1)
angle_4 = Angle(VectorA=unit_z_6, VectorB=expr("-x", evaluate_surface_2.Normal))  # -> Angle, Reflex
angle_5 = Angle(VectorA=unit_x_4, VectorB=expr("-x", evaluate_surface_2.Normal))  # -> Angle, Reflex
angle_6 = Angle(VectorA=unit_y_4, VectorB=expr("-x", evaluate_surface_2.Normal))  # -> Angle, Reflex
degrees_4 = Degrees(Radians=angle_4.Angle)
degrees_5 = Degrees(Radians=angle_5.Angle)
panel_30 = Panel(angle_4.Angle)
degrees_6 = Degrees(Radians=angle_6.Angle)
panel_31 = Panel(angle_5.Angle)
panel_32 = Panel(angle_6.Angle)

# ----
# Criação da superfície que será estrudada:
# 1 - offset da curva
# 2 - criação das superfícies
# 3 - subtração das superfícies
planar = Planar(Curve=list_item)  # -> Planar, Plane, Deviation
planar_2 = Planar(Curve=list_item)  # -> Planar, Plane, Deviation
negative = Negative(Value=espessura_3)
offset_curve = OffsetCurve(Curve=list_item, Distance=espessura_2, Plane=planar.Plane, Corners=1)
offset_curve_2 = OffsetCurve(Curve=list_item, Distance=negative, Plane=planar_2.Plane, Corners=1)
boundary_surfaces = BoundarySurfaces(Edges=offset_curve_2)
boundary_surfaces_2 = BoundarySurfaces(Edges=offset_curve)
solid_difference = SolidDifference(BrepsA=boundary_surfaces_2, BrepsB=boundary_surfaces)

panel_33 = Panel("Modelagem da Estrutura")

# ---- group: Aplica espessura a superfície
# Extrusão das vigas internas
unit_x_5 = UnitX(Factor=espessura)
extrude_3 = Extrude(Base=extrude, Direction=unit_x_5)

# ----
# Atribuição do gradiente a superfície
gradient = Gradient(
    LowerLimit=deconstruct_domain.Start,
    UpperLimit=deconstruct_domain.End,
    Parameter=principal_curvature.Maximum,
    stops=[0: RGB(234, 38, 0), 0.25: RGB(234, 126, 0), 0.5: RGB(254, 244, 84), 0.75: RGB(255, 127, 0), 1: RGB(255, 14, 0)])
custom_preview = CustomPreview(Geometry=isotrim, Material=gradient)

# ---- group: Aplica espessura as superfícies
# Extrusão das vigas internas
unit_y_5 = UnitY(Factor=espessura)
extrude_4 = Extrude(Base=extrude_2, Direction=unit_y_5)

# ----
# Criação do disco central
unit_z_7 = UnitZ(Factor=altura_disco_central)
extrude_5 = Extrude(Base=solid_difference, Direction=unit_z_7)

vector_display_3 = VectorDisplay(Anchor=evaluate_surface_2.Point, Vector=expr("x * -1", evaluate_surface_2.Normal))

# ---- group: Reparametrização da lista de vigas
flatten_tree = FlattenTree(Tree=extrude_3, Path="{0}")
partition_list_9 = PartitionList(List=flatten_tree, Size="1")

flatten_tree_2 = FlattenTree(Tree=extrude_4, Path="{0}")
partition_list_10 = PartitionList(List=flatten_tree_2, Size="1")

# ---- group: Retorna os componentes dos vetores
deconstruct_vector = DeconstructVector(Vector=evaluate_surface_2.Normal)  # -> XComponent, YComponent, ZComponent
panel_34 = Panel(deconstruct_vector.ZComponent)

# ----
shift_list = ShiftList(List=[extrude_3, extrude_4], Shift=1, Wrap=True)
brep_brep = BrepBrep(BrepA=shift_list, BrepB=flatten(extrude_5))  # -> Curves, Points
bounding_box = BoundingBox(Content=brep_brep.Curves, Plane=PlaneXY(0, 0, 0), UnionBox=True)  # -> Box, Box_2

panel_36 = Panel(partition_list_10)
panel_37 = Panel(partition_list_9)

# ---- group: Identificação das intersecções entre vigas
# Identificação dos pontos de intersecção entre Breps
brep_brep_2 = BrepBrep(BrepA=partition_list_9, BrepB=flatten(partition_list_10))  # -> Curves, Points

# ----
list_item_6 = ListItem(List=clean_tree_2, Index=Slider(0, range=0..20), Wrap=True)

# ----
# Cria esferas com origem nos pontos de intersecção.
# - Atribui como raio da esfera a diferença entre entre o valor Z do vetor e 1 (quanto maior a diferença maior a inclinação, consequentemente, maior a esfera)
panel_38 = Panel("1")
addition = Addition(A=panel_34, B=panel_38)
panel_39 = Panel(addition)
sphere = Sphere(Base=evaluate_surface_2.Point, Radius=addition)

# ----
# Criação do Box a partir do ponto de intersecção entre os Breps
bounding_box_2 = BoundingBox(Content=brep_brep_2.Curves, Plane=PlaneXY(0, 0, 0), UnionBox=True)  # -> Box, Box_2

clean_tree_5 = CleanTree(RemoveNulls=True, RemoveInvalid=True, RemoveEmpty=False, Tree=bounding_box.Box)

# ---- group: Movimentação dos BOX para subtração da geometria
# Movimentação das caixas em Z para posterior subtração dos volumes das vigas existentes
ghpython_script_2 = GhPythonScript(x=altura)  # -> out, a
# ---------- ghpython_script_2: Python ----------
a = x/2
# ---------- end ghpython_script_2 ----------
unit_z_8 = UnitZ(Factor=ghpython_script_2.a)
negative_2 = Negative(Value=unit_z_8)
move_5 = Move(Geometry=clean_tree_5, Motion=unit_z_8)  # -> Geometry, Transform
move_6 = Move(Geometry=bounding_box.Box, Motion=negative_2)  # -> Geometry, Transform

# Movimentação das caixas em Z para posterior subtração dos volumes das vigas existentes
ghpython_script_3 = GhPythonScript(x=altura)  # -> out, a; same code as ghpython_script_2
unit_z_9 = UnitZ(Factor=ghpython_script_3.a)
negative_3 = Negative(Value=unit_z_9)
move_7 = Move(Geometry=bounding_box_2.Box, Motion=unit_z_9)  # -> Geometry, Transform
move_8 = Move(Geometry=bounding_box_2.Box, Motion=negative_3)  # -> Geometry, Transform

# ----
panel_40 = Panel("Definição das conexões")
panel_41 = Panel(move_7.Geometry)
clean_tree_6 = CleanTree(RemoveNulls=True, RemoveInvalid=True, RemoveEmpty=False, Tree=move_5.Geometry)  # -> flatten(Tree)
sort_list_4 = SortList(Keys=partition_list_4)  # -> flatten(Keys), ValuesValuesA
bounds_3 = Bounds(Numbers=sort_list_4.Keys)
panel_43 = Panel(bounds_3)
panel_44 = Panel("Geometria final")

# ----
# subtração das caixas do aro central para criação dos encaixes Macho-Fêmea.
solid_difference_2 = SolidDifference(BrepsA=extrude_5, BrepsB=flatten(clean_tree_6))

# ----
# subtração das caixas das vigas criadas para criação dos encaixes Macho-Fêmea.
solid_difference_3 = SolidDifference(BrepsA=extrude_3, BrepsB=flatten([move_7.Geometry, move_6.Geometry]))
solid_difference_4 = SolidDifference(BrepsA=extrude_4, BrepsB=flatten([move_8.Geometry, move_6.Geometry]))

panel_45 = Panel(list_item_2)

# ---- group: Angulo Sentido X
panel_46 = Panel(degrees)
panel_47 = Panel(degrees_2)
panel_48 = Panel(degrees_3)

# ---- group: Angulo Sentido Y
panel_49 = Panel(degrees_4)
panel_50 = Panel(degrees_5)
panel_51 = Panel(degrees_6)

# ----
panel_52 = Panel(solid_difference_2)

# ---- group: Reparametrização da lista de vigas
flatten_tree_3 = FlattenTree(Tree=solid_difference_3, Path="{0}")
partition_list_11 = PartitionList(List=flatten_tree_3, Size="1")

flatten_tree_4 = FlattenTree(Tree=solid_difference_4, Path="{0}")
partition_list_12 = PartitionList(List=flatten_tree_4, Size="1")

# ----
# Extração dos perímetros das vigas
deconstruct_brep = DeconstructBrep(Brep=partition_list_12)  # -> Faces, Edges, Vertices
deconstruct_brep_2 = DeconstructBrep(Brep=partition_list_11)  # -> Faces, Edges, Vertices
list_item_7 = ListItem(List=deconstruct_brep.Faces, Index=0, Wrap=True)
list_item_8 = ListItem(List=deconstruct_brep_2.Faces, Index=Slider(4, range=0..20), Wrap=True)
curve = Curve(list_item_7)
curve_2 = Curve(list_item_8)

panel_54 = Panel("Identificação das peças")

# ---- group: Identificação das peças
panel_55 = Panel("A")

# ----
identificação_das_peças = IdentificaçãoDasPeças(data="B", tree=list_item_8, surface=list_item_8)
identificação_das_peças_a = IdentificaçãoDasPeçasA(data=panel_55, tree=list_item_7, surface=list_item_7)
brep_join = BrepJoin(Breps=[solid_difference_4, identificação_das_peças_a])  # -> Breps, Closed
brep_join_2 = BrepJoin(Breps=[solid_difference_3, identificação_das_peças])  # -> Breps, Closed
panel_57 = Panel("Geometria final identificada")

# ==== cluster IdentificaçãoDasPeças
tree = ClusterInput()
tree_statistics = TreeStatistics(Tree=tree)  # -> Paths, Length, Count
surface = ClusterInput()
data = ClusterInput()
evaluate_surface = EvaluateSurface(Surface=reparameterize(surface), Point="0.5,0.64")  # -> Point, Normal, UDirection, VDirection, Frame
series = Series(Start=0, Step=1, Count=tree_statistics.Count)  # -> graft(Series)
repeat_data = RepeatData(Data=data, Length=tree_statistics.Count)  # -> graft(Data)
merge = Merge(Data1=repeat_data, Data2=series)
text_join = TextJoin(Text=merge)
panel = Panel(text_join)
unit_x = UnitX(Factor=Slider(0.1, range=-1..1))
text = Text(Location=evaluate_surface.Frame, Text=text_join, Size=Slider(0.32, range=0..1))
extrude = Extrude(Base=text, Direction=unit_x)
extrusion = ClusterOutput(extrude)

# ==== cluster IdentificaçãoDasPeçasA
tree = ClusterInput()
tree_statistics = TreeStatistics(Tree=tree)  # -> Paths, Length, Count
surface = ClusterInput()
data = ClusterInput()
evaluate_surface = EvaluateSurface(Surface=reparameterize(surface), Point="0.5,0.64")  # -> Point, Normal, UDirection, VDirection, Frame
series = Series(Start=0, Step=1, Count=tree_statistics.Count)  # -> graft(Series)
repeat_data = RepeatData(Data=data, Length=tree_statistics.Count)  # -> graft(Data)
merge = Merge(Data1=repeat_data, Data2=series)
text_join = TextJoin(Text=merge)
panel = Panel(text_join)
unit_y = UnitY(Factor=Slider(-0.1, range=-1..1))
text = Text(Location=evaluate_surface.Frame, Text=text_join, Size=Slider(0.32, range=0..1))
extrude = Extrude(Base=text, Direction=unit_y)
extrusion = ClusterOutput(extrude)
