# Grasshopper definition Identificação de peças.gh (Grasshopper 1.0.7)
# plug-ins: PTComponentLibrary

espessura = Slider(0.25, range=0..1)
altura = Slider(0.6, range=0..1)
altura_disco_central = Slider(0.5, range=0..1)
number_slider = Slider(2.35, range=0..3)
surface = Surface(<surface referenced from the Rhino model>)
# Pontos de Observação:
# 1. Localização do disco central: a depender de onde está localizado e da distancia entre nervuras, o disco pode criar conexões complexas
panel = Panel("Definição da Forma")

# ----
# Identificação da curva que define o disco central
number_slider_2 = Slider(4, range=0..4)
brep_edges = BrepEdges(Brep=surface)  # -> Naked, Interior, NonManifold
list_item = ListItem(List=brep_edges.Naked, Index=number_slider_2, Wrap=True)

# ---- group: cálculo da área da superfície
# Cálculo da área da superfície que dá origem a estrutura complexa
area = Area(Geometry=surface)  # -> Area, Centroid

# ----
# Divide a superficie em partes iguais no sentido y
unit_y = UnitY(Factor=altura)
contour = Contour(Shape=surface, Point=area.Centroid, Direction=unit_y, Distance=number_slider)

# ---- group: X axis
# Divide a superficie em partes iguais no sentido x
unit_x = UnitX(Factor=1)
contour_2 = Contour(Shape=surface, Point=area.Centroid, Direction=unit_x, Distance=number_slider)

# ----
intersect_curves = IntersectCurves(CU=contour, CV=contour_2)
panel_2 = Panel(contour_2)
espessura_2 = Slider(0.25, range=0..1)
espessura_3 = Slider(0.2, range=0..1)

# ---- group: Aplica altura as linhas x
unit_z = UnitZ(Factor=altura)
extrude = Extrude(Base=contour_2, Direction=unit_z)

# ---- group: Aplica altura as linhas Y
unit_z_2 = UnitZ(Factor=altura)
extrude_2 = Extrude(Base=contour, Direction=unit_z_2)

# ----
# Criação da superfície que será estrudada:
# 1 - offset da curva
# 2 - criação das superfícies
# 3 - subtração das superfícies
planar = Planar(Curve=list_item)  # -> Planar, Plane, Deviation
planar_2 = Planar(Curve=list_item)  # -> Planar, Plane, Deviation
negative = Negative(Value=espessura_3)
offset_curve = OffsetCurve(Curve=list_item, Distance=espessura_2, Plane=planar.Plane, Corners=1)
offset_curve_2 = OffsetCurve(Curve=list_item, Distance=negative, Plane=planar_2.Plane, Corners=1)
boundary_surfaces = BoundarySurfaces(Edges=offset_curve_2)
boundary_surfaces_2 = BoundarySurfaces(Edges=offset_curve)
solid_difference = SolidDifference(BrepsA=boundary_surfaces_2, BrepsB=boundary_surfaces)

panel_4 = Panel("Modelagem da Estrutura")

# ---- group: Aplica espessura a superfície
# Extrusão das vigas internas
unit_x_2 = UnitX(Factor=espessura)
extrude_3 = Extrude(Base=extrude, Direction=unit_x_2)

# ---- group: Aplica espessura as superfícies
# Extrusão das vigas internas
unit_y_2 = UnitY(Factor=espessura)
extrude_4 = Extrude(Base=extrude_2, Direction=unit_y_2)

# ----
# Criação do disco central
unit_z_3 = UnitZ(Factor=altura_disco_central)
extrude_5 = Extrude(Base=solid_difference, Direction=unit_z_3)

# ---- group: Reparametrização da lista de vigas
flatten_tree = FlattenTree(Tree=extrude_3, Path="{0}")
partition_list = PartitionList(List=flatten_tree, Size="1")

flatten_tree_2 = FlattenTree(Tree=extrude_4, Path="{0}")
partition_list_2 = PartitionList(List=flatten_tree_2, Size="1")

# ----
shift_list = ShiftList(List=[extrude_3, extrude_4], Shift=1, Wrap=True)
brep_brep = BrepBrep(BrepA=shift_list, BrepB=flatten(extrude_5))  # -> Curves, Points
bounding_box = BoundingBox(Content=brep_brep.Curves, Plane=PlaneXY(0, 0, 0), UnionBox=True)  # -> Box, Box_2

panel_6 = Panel(partition_list_2)
panel_7 = Panel(partition_list)

# ---- group: Identificação das intersecções entre vigas
# Identificação dos pontos de intersecção entre Breps
brep_brep_2 = BrepBrep(BrepA=partition_list, BrepB=flatten(partition_list_2))  # -> Curves, Points

# ----
# Criação do Box a partir do ponto de intersecção entre os Breps
bounding_box_2 = BoundingBox(Content=brep_brep_2.Curves, Plane=PlaneXY(0, 0, 0), UnionBox=True)  # -> Box, Box_2

clean_tree = CleanTree(RemoveNulls=True, RemoveInvalid=True, RemoveEmpty=False, Tree=bounding_box.Box)

# ---- group: Movimentação dos BOX para subtração da geometria
# Movimentação das caixas em Z para posterior subtração dos volumes das vigas existentes
ghpython_script = GhPythonScript(x=altura)  # -> out, a
# ---------- ghpython_script: Python ----------
a = x/2
# ---------- end ghpython_script ----------
unit_z_4 = UnitZ(Factor=ghpython_script.a)
negative_2 = Negative(Value=unit_z_4)
move = Move(Geometry=clean_tree, Motion=unit_z_4)  # -> Geometry, Transform
move_2 = Move(Geometry=bounding_box.Box, Motion=negative_2)  # -> Geometry, Transform

# Movimentação das caixas em Z para posterior subtração dos volumes das vigas existentes
ghpython_script_2 = GhPythonScript(x=altura)  # -> out, a; same code as ghpython_script
unit_z_5 = UnitZ(Factor=ghpython_script_2.a)
negative_3 = Negative(Value=unit_z_5)
move_3 = Move(Geometry=bounding_box_2.Box, Motion=unit_z_5)  # -> Geometry, Transform
move_4 = Move(Geometry=bounding_box_2.Box, Motion=negative_3)  # -> Geometry, Transform

# ----
panel_8 = Panel("Definição das conexões")
panel_9 = Panel(move_3.Geometry)
clean_tree_2 = CleanTree(RemoveNulls=True, RemoveInvalid=True, RemoveEmpty=False, Tree=move.Geometry)  # -> flatten(Tree)
panel_11 = Panel("Geometria final")

# ----
# subtração das caixas do aro central para criação dos encaixes Macho-Fêmea.
solid_difference_2 = SolidDifference(BrepsA=extrude_5, BrepsB=flatten(clean_tree_2))

# ----
# subtração das caixas das vigas criadas para criação dos encaixes Macho-Fêmea.
solid_difference_3 = SolidDifference(BrepsA=extrude_3, BrepsB=flatten([move_3.Geometry, move_2.Geometry]))
solid_difference_4 = SolidDifference(BrepsA=extrude_4, BrepsB=flatten([move_4.Geometry, move_2.Geometry]))

panel_12 = Panel(solid_difference_2)

# ---- group: Reparametrização da lista de vigas
flatten_tree_3 = FlattenTree(Tree=solid_difference_3, Path="{0}")
partition_list_3 = PartitionList(List=flatten_tree_3, Size="1")

flatten_tree_4 = FlattenTree(Tree=solid_difference_4, Path="{0}")
partition_list_4 = PartitionList(List=flatten_tree_4, Size="1")

# ----
# Extração dos perímetros das vigas
deconstruct_brep = DeconstructBrep(Brep=partition_list_4)  # -> Faces, Edges, Vertices
deconstruct_brep_2 = DeconstructBrep(Brep=partition_list_3)  # -> Faces, Edges, Vertices
list_item_2 = ListItem(List=deconstruct_brep.Faces, Index=0, Wrap=True)
list_item_3 = ListItem(List=deconstruct_brep_2.Faces, Index=Slider(4, range=0..20), Wrap=True)
curve = Curve(list_item_2)
curve_2 = Curve(list_item_3)

panel_14 = Panel("Identificação das peças")

# ---- group: Identificação das peças
panel_15 = Panel("A")

# ----
identificação_das_peças = IdentificaçãoDasPeças(data="B", tree=list_item_3, surface=list_item_3)
identificação_das_peças_a = IdentificaçãoDasPeçasA(data=panel_15, tree=list_item_2, surface=list_item_2)
brep_join = BrepJoin(Breps=[solid_difference_4, identificação_das_peças_a])  # -> Breps, Closed
brep_join_2 = BrepJoin(Breps=[solid_difference_3, identificação_das_peças])  # -> Breps, Closed
panel_17 = Panel("Geometria final identificada")

# ==== cluster IdentificaçãoDasPeças
tree = ClusterInput()
tree_statistics = TreeStatistics(Tree=tree)  # -> Paths, Length, Count
surface = ClusterInput()
data = ClusterInput()
evaluate_surface = EvaluateSurface(Surface=reparameterize(surface), Point="0.5,0.64")  # -> Point, Normal, UDirection, VDirection, Frame
series = Series(Start=0, Step=1, Count=tree_statistics.Count)  # -> graft(Series)
repeat_data = RepeatData(Data=data, Length=tree_statistics.Count)  # -> graft(Data)
merge = Merge(Data1=repeat_data, Data2=series)
text_join = TextJoin(Text=merge)
panel = Panel(text_join)
unit_x = UnitX(Factor=Slider(0.1, range=-1..1))
text = Text(Location=evaluate_surface.Frame, Text=text_join, Size=Slider(0.32, range=0..1))
extrude = Extrude(Base=text, Direction=unit_x)
extrusion = ClusterOutput(extrude)

# ==== cluster IdentificaçãoDasPeçasA
tree = ClusterInput()
tree_statistics = TreeStatistics(Tree=tree)  # -> Paths, Length, Count
surface = ClusterInput()
data = ClusterInput()
evaluate_surface = EvaluateSurface(Surface=reparameterize(surface), Point="0.5,0.64")  # -> Point, Normal, UDirection, VDirection, Frame
series = Series(Start=0, Step=1, Count=tree_statistics.Count)  # -> graft(Series)
repeat_data = RepeatData(Data=data, Length=tree_statistics.Count)  # -> graft(Data)
merge = Merge(Data1=repeat_data, Data2=series)
text_join = TextJoin(Text=merge)
panel = Panel(text_join)
unit_y = UnitY(Factor=Slider(-0.1, range=-1..1))
text = Text(Location=evaluate_surface.Frame, Text=text_join, Size=Slider(0.32, range=0..1))
extrude = Extrude(Base=text, Direction=unit_y)
extrusion = ClusterOutput(extrude)
